# Grasshopper definition GHSpeckleStructuralExample.gh (Grasshopper 1.0.7)
# plug-ins: UserDataUtils

rectangle = Rectangle(Plane=PlaneXY(0, 0, 0), XSize="-5000 to 5000", YSize="-5000 to 5000", Radius=0)  # -> Rectangle, Length
Z = UnitZ(Factor=Slider(5000, range=0..10000))
cp = ControlPoints(Curve=rectangle.Rectangle)  # -> Points, Weights, Knots
mplane = MeshPlane(Boundary=rectangle.Rectangle, WidthCount=10, HeightCount=10)  # -> Mesh, Area
cull_i = CullIndex(List=cp.Points, Indices=0, Wrap=True)
move = Move(Geometry=mplane.Mesh, Motion=Z)  # -> Geometry, Transform
move_2 = Move(Geometry=cull_i, Motion=Z)  # -> Geometry, Transform
panel = Panel("""True
True
True
False
False
False""")
shift = ShiftList(List=move_2.Geometry, Shift=-1, Wrap=True)
shift_2 = ShiftList(List=move_2.Geometry, Shift=1, Wrap=True)
ln = Line(StartPoint=move_2.Geometry, EndPoint=cull_i)
ln_2 = Line(StartPoint=shift, EndPoint=cull_i)
ln_3 = Line(StartPoint=shift_2, EndPoint=cull_i)
bool = Boolean(panel)
rectangle_2 = Rectangle(Plane=PlaneXY(0, 0, 0), XSize="-100 to 100", YSize="-100 to 100", Radius=0)  # -> Rectangle, Length
rectangle_3 = Rectangle(Plane=PlaneXY(0, 0, 0), XSize="-50 to 50", YSize="-50 to 50", Radius=0)  # -> Rectangle, Length
elementtype = ElementType({"NotSet": 0, "Generic": 1, "Column": 2, "Beam": 3, "Cantilever": 4, "Brace": 5, "Spring": 6}, selected="Column")
referencesurface = ReferenceSurface({"NotSet": 0, "Top": 1, "Middle": 2, "Bottom": 3}, selected="NotSet")
sbc = SchemaBuilderComponent(
    Value=bool,
    assembly="SpeckleStructuralClasses.StructuralVectorBoolSix, SpeckleStructuralClasses, Version=1.0.24.0, Culture=neutral, PublicKeyToken=null",
    init=True,
    type="StructuralVectorBoolSix")
elementtype_2 = ElementType({"NotSet": 0, "Generic": 1, "Slab": 2, "Wall": 3}, selected="Slab")
elementtype_3 = ElementType({"NotSet": 0, "Generic": 1, "Column": 2, "Beam": 3, "Cantilever": 4, "Brace": 5, "Spring": 6}, selected="Brace")
shape = Shape({"NotSet": 0, "Generic": 1, "Circular": 2, "Rectangular": 3, "I": 4, "T": 5}, selected="Rectangular")
shape_2 = Shape({"NotSet": 0, "Generic": 1, "Circular": 2, "Rectangular": 3, "I": 4, "T": 5}, selected="Rectangular")
sbc_2 = SchemaBuilderComponent(
    BaseMesh=move.Geometry,
    ElementType=elementtype_2,
    PropertyRef="slabProp",
    assembly="SpeckleStructuralClasses.Structural2DElementMesh, SpeckleStructuralClasses, Version=1.0.24.0, Culture=neutral, PublicKeyToken=null",
    init=True,
    type="Structural2DElementMesh")
sbc_3 = SchemaBuilderComponent(
    BaseLine=ln,
    ElementType=elementtype,
    PropertyRef="colProp",
    assembly="SpeckleStructuralClasses.Structural1DElement, SpeckleStructuralClasses, Version=1.0.24.0, Culture=neutral, PublicKeyToken=null",
    init=True,
    type="Structural1DElement")
sbc_4 = SchemaBuilderComponent(
    BasePoint=cull_i,
    Restraint=sbc,
    assembly="SpeckleStructuralClasses.StructuralNode, SpeckleStructuralClasses, Version=1.0.24.0, Culture=neutral, PublicKeyToken=null",
    init=True,
    type="StructuralNode")
sbc_5 = SchemaBuilderComponent(
    Profile=rectangle_2.Rectangle,
    Shape=shape,
    Thickness=Slider(10, range=0..10),
    ApplicationId="colProp",
    assembly="SpeckleStructuralClasses.Structural1DProperty, SpeckleStructuralClasses, Version=1.0.24.0, Culture=neutral, PublicKeyToken=null",
    init=True,
    type="Structural1DProperty")
sbc_6 = SchemaBuilderComponent(
    Profile=rectangle_3.Rectangle,
    Shape=shape_2,
    Thickness=Slider(5, range=0..10),
    ApplicationId="braceProp",
    assembly="SpeckleStructuralClasses.Structural1DProperty, SpeckleStructuralClasses, Version=1.0.24.0, Culture=neutral, PublicKeyToken=null",
    init=True,
    type="Structural1DProperty")
sbc_7 = SchemaBuilderComponent(
    BaseLine=[ln_3, ln_2],
    ElementType=elementtype_3,
    PropertyRef="braceProp",
    assembly="SpeckleStructuralClasses.Structural1DElement, SpeckleStructuralClasses, Version=1.0.24.0, Culture=neutral, PublicKeyToken=null",
    init=True,
    type="Structural1DElement")
sbc_8 = SchemaBuilderComponent(
    Thickness="250",
    ReferenceSurface=referencesurface,
    ApplicationId="slabProp",
    assembly="SpeckleStructuralClasses.Structural2DProperty, SpeckleStructuralClasses, Version=1.0.24.0, Culture=neutral, PublicKeyToken=null",
    init=True,
    type="Structural2DProperty")
anonymous_stream = DataSender(A=sbc_2, B=sbc_3, C=sbc_4, D=sbc_7, DebouncingDisabled=False, manualmode=False, remotecontroller=False)  # -> Log, StreamId
anonymous_stream_2 = DataSender(A=sbc_5, B=sbc_6, C=sbc_8, DebouncingDisabled=False, manualmode=False, remotecontroller=False)  # -> Log, StreamId
panel_2 = Panel([anonymous_stream.StreamId, anonymous_stream_2.StreamId])
