# Grasshopper definition ghdemo.gh (Grasshopper 1.0.7)
# plug-ins: UserDataUtils

# ---- group: Controls
base_scale_factor = Slider(2.539, range=1..10)
base_floor_heights = Slider(8.515, range=4..12)
base_number_floors = Slider(2, range=1..50)
top_floor_height = Slider(4.876, range=4..12)
top_number_floors = Slider(2, range=1..50)

# ---- group: Base Polyline Geometry
geo = Geometry(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)

# ---- group: Base Transforms
series = Series(Start=base_floor_heights, Step=base_floor_heights, Count=base_number_floors)
Z = UnitZ(Factor=series)

# ---- group: Top Transforms
series_2 = Series(Start=top_floor_height, Step=top_floor_height, Count=top_number_floors)
Z_2 = UnitZ(Factor=series_2)

# ---- group: Shift Top
multiplication = Multiplication(A=base_floor_heights, B=base_number_floors)
Z_3 = UnitZ(Factor=multiplication)
move = Move(Geometry=geo, Motion=Z_3)  # -> Geometry, Transform

# ---- group: Generate Base Floors
boundary = BoundarySurfaces(Edges=geo)
pcen = PolygonCenter(Polyline=boundary)  # -> CenterV, CenterE, CenterA
scale = Scale(Geometry=boundary, Center=pcen.CenterA, Factor=base_scale_factor)  # -> Geometry, Transform
mesh = MeshBrep(
    Brep=scale.Geometry,
    Settings={GridMaxCount=0, GridMinCount=16, JaggedSeams=False, MaxEdgeLength=0, MinEdgeLength=0.0001, MinTolerance=0, Refine=True, RefineAngle=0, RelativeTolerance=0.65, SimplePlanes=True, Tolerance=0})
move_2 = Move(Geometry=mesh, Motion=Z)  # -> Geometry, Transform

# ---- group: Generate Top Floors
boundary_2 = BoundarySurfaces(Edges=move.Geometry)
mesh_2 = MeshBrep(
    Brep=boundary_2,
    Settings={GridMaxCount=0, GridMinCount=16, JaggedSeams=False, MaxEdgeLength=0, MinEdgeLength=0.0001, MinTolerance=0, Refine=True, RefineAngle=0, RelativeTolerance=0.65, SimplePlanes=True, Tolerance=0})
move_3 = Move(Geometry=mesh_2, Motion=Z_2)  # -> Geometry, Transform

# ---- group: Generate Top Columns
cp = ControlPoints(Curve=boundary_2)  # -> Points, Weights, Knots
cull_i = CullIndex(List=cp.Points, Indices="0", Wrap=True)
move_4 = Move(Geometry=cull_i, Motion=graft(Z_2))  # -> Geometry, Transform
path_mapper = PathMapper(cull_i, source="{a;b;0}(i)", target="{a;b;0}(i)")
path_mapper_2 = PathMapper(move_4.Geometry, source="{a;b;c}(i)", target="{a;b;c+1}(i)")
data = Data([path_mapper, path_mapper_2])
path_mapper_3 = PathMapper(data, source="{a;b;c}(i)", target="{i}(c)")
cull_i_2 = CullIndex(List=path_mapper_3, Indices="-1", Wrap=True)
shift = ShiftList(List=path_mapper_3, Shift=1, Wrap=False)
ln = Line(StartPoint=shift, EndPoint=cull_i_2)

# ---- group: Generate Base Columns
cp_2 = ControlPoints(Curve=scale.Geometry)  # -> Points, Weights, Knots
cull_i_3 = CullIndex(List=cp_2.Points, Indices="0", Wrap=True)
move_5 = Move(Geometry=cull_i_3, Motion=graft(Z))  # -> Geometry, Transform
path_mapper_4 = PathMapper(cull_i_3, source="{a;b;0}(i)", target="{a;b;0}(i)")
path_mapper_5 = PathMapper(move_5.Geometry, source="{a;b;c}(i)", target="{a;b;c+1}(i)")
data_2 = Data([path_mapper_4, path_mapper_5])
path_mapper_6 = PathMapper(data_2, source="{a;b;c}(i)", target="{i}(c)")
cull_i_4 = CullIndex(List=path_mapper_6, Indices="-1", Wrap=True)
shift_2 = ShiftList(List=path_mapper_6, Shift=1, Wrap=False)
ln_2 = Line(StartPoint=shift_2, EndPoint=cull_i_4)

# ---- group: Scale to mm
scale_to_mm = Scale(Geometry=cull_i_3, Center=Point(0, 0, 0), Factor="1000")  # -> Geometry, Transform

scale_to_mm_2 = Scale(Geometry=[ln_2, ln], Center=Point(0, 0, 0), Factor="1000")  # -> Geometry, Transform

scale_to_mm_3 = Scale(Geometry=[move_2.Geometry, move_3.Geometry], Center=Point(0, 0, 0), Factor="1000")  # -> Geometry, Transform

# ---- group: Voids
demesh = DeconstructMesh(Mesh=scale_to_mm_3.Geometry)  # -> Vertices, Faces, Colours, Normals
avr = Average(Input=demesh.Vertices)  # -> flatten(ArithmeticMean)
scale_to_mm_4 = Scale(Geometry=scale_to_mm_3.Geometry, Center=avr, Factor="0.5")  # -> Geometry, Transform

# ----
geo_2 = Geometry(scale_to_mm_4.Geometry)
column = Geometry(scale_to_mm_2.Geometry)

geo_3 = Geometry([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])
scale_to_mm_5 = Scale(Geometry=geo_3, Center=Point(0, 0, 0), Factor="1")  # -> Geometry, Transform
vec = VectorXYZ(XComponent=0, YComponent=0, ZComponent="-1.2")  # -> Vector, Length
vec_2 = VectorXYZ(XComponent=0, YComponent=0, ZComponent="-5")  # -> Vector, Length
sbc = SchemaBuilderComponent(
    BaseVector=vec.Vector,
    assembly="SpeckleStructuralClasses.StructuralVectorThree, SpeckleStructuralClasses, Version=1.0.0.2, Culture=neutral, PublicKeyToken=null",
    init=True,
    type="StructuralVectorThree")
sbc_2 = SchemaBuilderComponent(
    BaseVector=vec_2.Vector,
    assembly="SpeckleStructuralClasses.StructuralVectorThree, SpeckleStructuralClasses, Version=1.0.0.2, Culture=neutral, PublicKeyToken=null",
    init=True,
    type="StructuralVectorThree")
cvso = ConvertsASpeckleObject(
    Input=scale_to_mm_5.Geometry,
    assembly="SpeckleStructuralClasses.Structural2DLoadPanel, SpeckleStructuralClasses, Version=1.0.0.2, Culture=neutral, PublicKeyToken=null",
    init=True,
    type="Structural2DLoadPanel")
cvso_2 = ConvertsASpeckleObject(
    Input=scale_to_mm_5.Geometry,
    assembly="SpeckleStructuralClasses.Structural2DLoadPanel, SpeckleStructuralClasses, Version=1.0.0.2, Culture=neutral, PublicKeyToken=null",
    init=True,
    type="Structural2DLoadPanel")
msop = ModifiesSpeckleObjectProperties(
    Input=cvso,
    Loading=sbc_2,
    LoadCaseRef="Live",
    assembly="SpeckleStructuralClasses.Structural2DLoadPanel, SpeckleStructuralClasses, Version=1.0.0.2, Culture=neutral, PublicKeyToken=null",
    init=True,
    type="Structural2DLoadPanel")
msop_2 = ModifiesSpeckleObjectProperties(
    Input=cvso_2,
    Loading=sbc,
    LoadCaseRef="SDL",
    assembly="SpeckleStructuralClasses.Structural2DLoadPanel, SpeckleStructuralClasses, Version=1.0.0.2, Culture=neutral, PublicKeyToken=null",
    init=True,
    type="Structural2DLoadPanel")

column_2 = Geometry(scale_to_mm.Geometry)
geo_4 = Geometry(scale_to_mm_3.Geometry)

# ---- group: Restrain Nodes
panel = Panel("""True
True
True
True
True
True""")
cvso_3 = ConvertsASpeckleObject(
    Input=column_2,
    assembly="SpeckleStructuralClasses.StructuralNode, SpeckleStructuralClasses, Version=1.0.0.2, Culture=neutral, PublicKeyToken=null",
    init=True,
    type="StructuralNode")
bool = Boolean(panel)
sbc_3 = SchemaBuilderComponent(
    Value=bool,
    assembly="SpeckleStructuralClasses.StructuralVectorBoolSix, SpeckleStructuralClasses, Version=1.0.0.2, Culture=neutral, PublicKeyToken=null",
    init=True,
    type="StructuralVectorBoolSix")
msop_3 = ModifiesSpeckleObjectProperties(
    Input=cvso_3,
    Restraint=sbc_3,
    assembly="SpeckleStructuralClasses.StructuralNode, SpeckleStructuralClasses, Version=1.0.0.2, Culture=neutral, PublicKeyToken=null",
    init=True,
    type="StructuralNode")

# ---- group: Attach 2D Property
cvso_4 = ConvertsASpeckleObject(
    Input=geo_4,
    assembly="SpeckleStructuralClasses.Structural2DElementMesh, SpeckleStructuralClasses, Version=1.0.0.2, Culture=neutral, PublicKeyToken=null",
    init=True,
    type="Structural2DElementMesh")
msop_4 = ModifiesSpeckleObjectProperties(
    Input=cvso_4,
    ElementType="Slab",
    PropertyRef="slabProp",
    assembly="SpeckleStructuralClasses.Structural2DElementMesh, SpeckleStructuralClasses, Version=1.0.0.2, Culture=neutral, PublicKeyToken=null",
    init=True,
    type="Structural2DElementMesh")

# ---- group: Attach 1D Property
panel_2 = Panel("""False
False
False
False
False
False""")
bool_2 = Boolean(panel_2)
cvso_5 = ConvertsASpeckleObject(
    Input=flatten(column),
    assembly="SpeckleStructuralClasses.Structural1DElement, SpeckleStructuralClasses, Version=1.0.0.2, Culture=neutral, PublicKeyToken=null",
    init=True,
    type="Structural1DElement")  # -> flatten(Structural1DElement)
sbc_4 = SchemaBuilderComponent(
    Value=bool_2,
    assembly="SpeckleStructuralClasses.StructuralVectorBoolSix, SpeckleStructuralClasses, Version=1.0.0.2, Culture=neutral, PublicKeyToken=null",
    init=True,
    type="StructuralVectorBoolSix")
repeat = RepeatData(Data=sbc_4, Length="2")
msop_5 = ModifiesSpeckleObjectProperties(
    Input=cvso_5,
    ElementType="Column",
    PropertyRef="columnProp",
    EndRelease=repeat,
    assembly="SpeckleStructuralClasses.Structural1DElement, SpeckleStructuralClasses, Version=1.0.0.2, Culture=neutral, PublicKeyToken=null",
    init=True,
    type="Structural1DElement")

# ---- group: 2D Section Property
sbc_5 = SchemaBuilderComponent(
    Thickness="300",
    MaterialRef="concrete",
    ReferenceSurface="Top",
    ApplicationId="slabProp",
    assembly="SpeckleStructuralClasses.Structural2DProperty, SpeckleStructuralClasses, Version=1.0.0.2, Culture=neutral, PublicKeyToken=null",
    init=True,
    type="Structural2DProperty")

# ---- group: Voids
cvso_6 = ConvertsASpeckleObject(
    Input=geo_2,
    assembly="SpeckleStructuralClasses.Structural2DVoid, SpeckleStructuralClasses, Version=1.0.0.2, Culture=neutral, PublicKeyToken=null",
    init=True,
    type="Structural2DVoid")
msop_6 = ModifiesSpeckleObjectProperties(
    Input=cvso_6,
    assembly="SpeckleStructuralClasses.Structural2DVoid, SpeckleStructuralClasses, Version=1.0.0.2, Culture=neutral, PublicKeyToken=null",
    init=True,
    type="Structural2DVoid")

# ---- group: 1D Section Property
cir = Circle(Plane=PlaneXY(0, 0, 0), Radius="1000")
sbc_6 = SchemaBuilderComponent(
    Profile=cir,
    Shape="Circular",
    MaterialRef="concrete",
    ApplicationId="columnProp",
    assembly="SpeckleStructuralClasses.Structural1DProperty, SpeckleStructuralClasses, Version=1.0.0.2, Culture=neutral, PublicKeyToken=null",
    init=True,
    type="Structural1DProperty")

# ---- group: Load Task
num = Number("1")
num_2 = Number("1")
sbc_7 = SchemaBuilderComponent(
    TaskType="LinearStatic",
    LoadCaseRefs="SDL",
    LoadFactors=num,
    ApplicationId="SDL",
    assembly="SpeckleStructuralClasses.StructuralLoadTask, SpeckleStructuralClasses, Version=1.0.0.2, Culture=neutral, PublicKeyToken=null",
    init=True,
    type="StructuralLoadTask")
sbc_8 = SchemaBuilderComponent(
    TaskType="LinearStatic",
    LoadCaseRefs="Live",
    LoadFactors=num_2,
    ApplicationId="Live",
    assembly="SpeckleStructuralClasses.StructuralLoadTask, SpeckleStructuralClasses, Version=1.0.0.2, Culture=neutral, PublicKeyToken=null",
    init=True,
    type="StructuralLoadTask")

# ---- group: Material
sbc_9 = SchemaBuilderComponent(
    YoungsModulus="24600000000",
    ShearModulus="10270000000",
    PoissonsRatio="0.2",
    Density="2300",
    CoeffThermalExpansion="0.00001",
    CompressiveStrength="35000000",
    MaxStrain="0.0035",
    AggragateSize="0.02",
    ApplicationId="concrete",
    assembly="SpeckleStructuralClasses.StructuralMaterialConcrete, SpeckleStructuralClasses, Version=1.0.0.2, Culture=neutral, PublicKeyToken=null",
    init=True,
    type="StructuralMaterialConcrete")

# ---- group: Load Case
panel_3 = Panel("SDL")
panel_4 = Panel("Live")
sbc_10 = SchemaBuilderComponent(
    CaseType="Dead",
    ApplicationId=panel_3,
    assembly="SpeckleStructuralClasses.StructuralLoadCase, SpeckleStructuralClasses, Version=1.0.0.2, Culture=neutral, PublicKeyToken=null",
    init=True,
    type="StructuralLoadCase")
sbc_11 = SchemaBuilderComponent(
    CaseType="Live",
    assembly="SpeckleStructuralClasses.StructuralLoadCase, SpeckleStructuralClasses, Version=1.0.0.2, Culture=neutral, PublicKeyToken=null",
    init=True,
    type="StructuralLoadCase")

# ---- group: Load Combo
panel_5 = Panel("""1.5
1.25""")
panel_6 = Panel([panel_4, panel_3])
num_3 = Number(panel_5)
sbc_12 = SchemaBuilderComponent(
    ComboType="LinearAdd",
    LoadTaskRefs=panel_6,
    LoadTaskFactors=num_3,
    assembly="SpeckleStructuralClasses.StructuralLoadCombo, SpeckleStructuralClasses, Version=1.0.0.2, Culture=neutral, PublicKeyToken=null",
    init=True,
    type="StructuralLoadCombo")

# ----
# Properties
anonymous_stream = DataSender(A=sbc_6, B=sbc_5, C=sbc_9, manualmode=False, remotecontroller=False)  # -> Log, flatten(StreamId)
# Loads
anonymous_stream_2 = DataSender(A=[sbc_11, sbc_10], B=[msop_2, msop], C=sbc_12, D=[sbc_8, sbc_7], manualmode=False, remotecontroller=False)  # -> Log, flatten(StreamId)
# Nodes and Elements
anonymous_stream_3 = DataSender(A=msop_4, B=msop_3, C=msop_5, D=msop_6, manualmode=False, remotecontroller=False)  # -> Log, flatten(StreamId)
panel_7 = Panel([anonymous_stream_2.StreamId, anonymous_stream.StreamId, anonymous_stream_3.StreamId])
